# Grasshopper definition MJProcGen.gh (Grasshopper 1.0.8)
# plug-ins: MJ_Proc_Gen

panel = Panel("C:\Users\Drew\Desktop\Projects\MJ Proc Gen\rulesets\random.xml")
panel_2 = Panel("C:\Users\Drew\Desktop\Projects\MJ Proc Gen\rulesets\trees.xml")
panel_3 = Panel("C:\Users\Drew\Desktop\Projects\MJ Proc Gen\rulesets\rotref.xml")
# C:\Users\Drew\Desktop\Projects\MJ Proc Gen\rulesets\ModernHouse.xml
panel_4 = Panel("C:\Users\Drew\Desktop\Projects\MJ Proc Gen\rulesets\BrickBuilding.xml")
panel_5 = Panel("C:\Users\Drew\Desktop\Projects\MJ Proc Gen\rulesets\WeightsAndBreaks.xml")
panel_6 = Panel("C:\Users\Drew\Desktop\Projects\MJ Proc Gen\rulesets\huts.xml")
panel_7 = Panel("C:\Users\Drew\Desktop\Projects\MJ Proc Gen\rulesets\walker.xml")
panel_8 = Panel("C:\Users\Drew\Desktop\Projects\MJ Proc Gen\rulesets\walkerRetrace.xml")

# ---- group: Basic Shapes
pt = Point(<point referenced from the Rhino model>)
object = ModelObject(<model object referenced from the Rhino model>)
object_2 = ModelObject(<model object referenced from the Rhino model>)
pt_2 = Point(<point referenced from the Rhino model>)
pt_3 = Point(<point referenced from the Rhino model>)
pt_4 = Point(<point referenced from the Rhino model>)
object_3 = ModelObject(<model object referenced from the Rhino model>)
object_4 = ModelObject(<model object referenced from the Rhino model>)
pt_5 = Point(<point referenced from the Rhino model>)
object_5 = ModelObject(<model object referenced from the Rhino model>)
pt_6 = Point(<point referenced from the Rhino model>)
object_6 = ModelObject(<model object referenced from the Rhino model>)
sample = Sample(ReferenceName="CYL", ReferencePoint=pt_6, ModelObject=object_6)
sample_2 = Sample(ReferenceName="SPS", ReferencePoint=pt_3, ModelObject=object_3)
sample_3 = Sample(ReferenceName="SPH", ReferencePoint=pt_4, ModelObject=object_4)
sample_4 = Sample(ReferenceName="BOX", ReferencePoint=pt_2, ModelObject=object_2)
sample_5 = Sample(ReferenceName="BXS", ReferencePoint=pt, ModelObject=object)
sample_6 = Sample(ReferenceName="AIR", ReferencePoint=pt_2)
sample_7 = Sample(ReferenceName="BXV", ReferencePoint=pt_5, ModelObject=object_5)
merge = Merge(Data1=sample_6, Data2=sample_4, Data3=sample_5, Data4=sample, Data5=sample_3, Data6=sample_2, Data7=sample_7)

# ---- group: Create Space
number_slider = Slider(20, range=1..100)
number_slider_2 = Slider(20, range=1..100)
number_slider_3 = Slider(20, range=1..100)
panel_9 = Panel("space")
mj_space = MJSpace(Name=panel_9, XSize=number_slider, YSize=number_slider_2, ZSize=number_slider_3, DefaultState="AIR")

# ---- group: Run Parameters
number_slider_4 = Slider(3000, range=0..10000)
number_slider_5 = Slider(-600349, range=-1000000..1000000)
frame_100 = Slider(6, range=1..100)
frame_1000 = Slider(86, range=1..1000)
frame_10000 = Slider(1, range=1..10000)
panel_10 = Panel("BrickBuilding")
refresh = Button()

# ----
rule = Rule(Name="MTLCornerSpread", Type="parallel", RuleDefinition="MTL/BLU=MTL/MTL", ReflectZ="true")
rule_2 = Rule(Name="REDCornerSpread", Type="parallel", RuleDefinition="RED/BLU=RED/RED", ReflectZ="true")
rule_3 = Rule(Name="BRKCornerSpread", Type="parallel", RuleDefinition="BRK/BLU=BRK/BRK", ReflectZ="true")

# ---- group: Colored Boxes
pt_7 = Point(<point referenced from the Rhino model>)
object_7 = ModelObject(<model object referenced from the Rhino model>)
pt_8 = Point(<point referenced from the Rhino model>)
object_8 = ModelObject(<model object referenced from the Rhino model>)
pt_9 = Point(<point referenced from the Rhino model>)
object_9 = ModelObject(<model object referenced from the Rhino model>)
pt_10 = Point(<point referenced from the Rhino model>)
object_10 = ModelObject(<model object referenced from the Rhino model>)
pt_11 = Point(<point referenced from the Rhino model>)
pt_12 = Point(<point referenced from the Rhino model>)
object_11 = ModelObject(<model object referenced from the Rhino model>)
object_12 = ModelObject(<model object referenced from the Rhino model>)
pt_13 = Point(<point referenced from the Rhino model>)
object_13 = ModelObject(<model object referenced from the Rhino model>)
sample_8 = Sample(ReferenceName="PRP", ReferencePoint=pt_7, ModelObject=object_7)
sample_9 = Sample(ReferenceName="GRY", ReferencePoint=pt_8, ModelObject=object_8)
sample_10 = Sample(ReferenceName="BLU", ReferencePoint=pt_9, ModelObject=object_9)
sample_11 = Sample(ReferenceName="RED", ReferencePoint=pt_13, ModelObject=object_13)
sample_12 = Sample(ReferenceName="YLW", ReferencePoint=pt_10, ModelObject=object_10)
sample_13 = Sample(ReferenceName="ORG", ReferencePoint=pt_12, ModelObject=object_11)
sample_14 = Sample(ReferenceName="GRN", ReferencePoint=pt_11, ModelObject=object_12)
merge_2 = Merge(Data1=sample_11, Data2=sample_13, Data3=sample_12, Data4=sample_14, Data5=sample_10, Data6=sample_8, Data7=sample_9)

# ---- group: Finished Material
pt_14 = Point(<point referenced from the Rhino model>)
object_14 = ModelObject(<model object referenced from the Rhino model>)
object_15 = ModelObject(<model object referenced from the Rhino model>)
pt_15 = Point(<point referenced from the Rhino model>)
pt_16 = Point(<point referenced from the Rhino model>)
object_16 = ModelObject([<model object referenced from the Rhino model> x2])
pt_17 = Point(<point referenced from the Rhino model>)
object_17 = ModelObject([<model object referenced from the Rhino model> x2])
pt_18 = Point(<point referenced from the Rhino model>)
object_18 = ModelObject(<model object referenced from the Rhino model>)
pt_19 = Point(<point referenced from the Rhino model>)
object_19 = ModelObject(<model object referenced from the Rhino model>)
sample_15 = Sample(ReferenceName="BRK", ReferencePoint=pt_15, ModelObject=object_14)
sample_16 = Sample(ReferenceName="WDX", ReferencePoint=pt_16, ModelObject=object_16)
sample_17 = Sample(ReferenceName="WDY", ReferencePoint=pt_17, ModelObject=object_17)
sample_18 = Sample(ReferenceName="MTL", ReferencePoint=pt_19, ModelObject=object_19)
sample_19 = Sample(ReferenceName="CNC", ReferencePoint=pt_18, ModelObject=object_18)
sample_20 = Sample(ReferenceName="OAK", ReferencePoint=pt_14, ModelObject=object_15)
merge_3 = Merge(Data1=sample_15, Data2=sample_16, Data3=sample_17, Data4=sample_19, Data5=sample_20, Data6=sample_18)

# ----
break = Break(Name="BreakCNCSeed", Weight="1")
rule_4 = Rule(Name="ConcreteSeed", Weight="1", RuleDefinition="PRP=CNC")
rule_5 = Rule(Name="ConcreteSpread", Type="parallel", RuleDefinition="CNC/PRP=CNC/CNC", RotateX="true", RotateY="true")
break_2 = Break(Name="BreakBRKSeed", Weight="1")
rule_6 = Rule(Name="BrickSeed", Weight="9", RuleDefinition="PRP=BRK")
rule_7 = Rule(Name="BrickSpread", Type="parallel", RuleDefinition="BRK/PRP=BRK/BRK", RotateX="true", RotateY="true")
break_3 = Break(Name="BreakREDSeed", Weight="1")
rule_8 = Rule(Name="RedSeed", Weight="4", RuleDefinition="PRP=RED")
rule_9 = Rule(Name="RedSpread", Type="parallel", RuleDefinition="RED/PRP=RED/RED", RotateX="true", RotateY="true")
rule_10 = Rule(Name="MTLCornerSeed", RuleDefinition="MTL,BLU=MTL,MTL", RotateZ="true")
ruleset = RuleSet(Name="MTLCornerSpreadRS", Type="sequence", Repeat="true", Children=rule)
merge_4 = Merge(Data1=rule_4, Data2=break)
merge_5 = Merge(Data1=rule_6, Data2=break_2)
merge_6 = Merge(Data1=rule_8, Data2=break_3)
rule_11 = Rule(Name="REDCornerSeed", RuleDefinition="RED,BLU=RED,RED", RotateZ="true")
ruleset_2 = RuleSet(Name="REDCornerSpreadRS", Type="sequence", Repeat="true", Children=rule_2)
rule_12 = Rule(Name="BRKCornerSeed", RuleDefinition="BRK,BLU=BRK,BRK", RotateZ="true")
ruleset_3 = RuleSet(Name="BRKCornerSpreadRS", Type="sequence", Repeat="true", Children=rule_3)
ruleset_4 = RuleSet(Name="ConcreteSeedRS", Type="random", Repeat="true", Children=merge_4)
ruleset_5 = RuleSet(Name="ConcreteSpreadRS", Type="sequence", Repeat="true", Children=rule_5)
ruleset_6 = RuleSet(Name="BrickSeedRS", Type="random", Repeat="true", Children=merge_5)
ruleset_7 = RuleSet(Name="BrickSpreadRS", Type="sequence", Repeat="true", Children=rule_7)
ruleset_8 = RuleSet(Name="RedSeedRS", Type="random", Repeat="true", Children=merge_6)
ruleset_9 = RuleSet(Name="RedSpreadRS", Type="sequence", Repeat="true", Children=rule_9)
merge_7 = Merge(Data1=rule_10, Data2=ruleset)
merge_8 = Merge(Data1=rule_11, Data2=ruleset_2)
merge_9 = Merge(Data1=rule_12, Data2=ruleset_3)
ruleset_10 = RuleSet(Name="MTLCornerRS", Type="sequence", Weight="1", Children=merge_7)
merge_10 = Merge(Data1=ruleset_4, Data2=ruleset_5)
merge_11 = Merge(Data1=ruleset_6, Data2=ruleset_7)
merge_12 = Merge(Data1=ruleset_8, Data2=ruleset_9)
ruleset_11 = RuleSet(Name="REDCornerRS", Type="sequence", Weight="1", Children=merge_8)
ruleset_12 = RuleSet(Name="BRKCornerRS", Type="sequence", Weight="1", Children=merge_9)
rule_13 = Rule(Name="REDtoGRY", Type="parallel", RuleDefinition="RED=GRY")
ruleset_13 = RuleSet(Name="ConcretePanelRS", Type="sequence", Children=merge_10)
ruleset_14 = RuleSet(Name="BrickPanelRS", Type="sequence", Children=merge_11)
ruleset_15 = RuleSet(Name="RedPanelRS", Type="sequence", Children=merge_12)
rule_14 = Rule(Name="YLWtoCNC", Type="parallel", RuleDefinition="YLW=CNC")
rule_15 = Rule(Name="PRPtoMTL", Type="parallel", RuleDefinition="PRP=MTL")
rule_16 = Rule(Name="ORGtoCNC", Type="parallel", RuleDefinition="ORG=CNC")
rule_17 = Rule(Name="RemoveColumnInGround", Type="parallel", RuleDefinition="BOX,BLU=BOX,BOX", RotateZ="true")
rule_18 = Rule(Name="CNCCorner", Type="parallel", RuleDefinition="CNC,*;BLU,CNC=CNC,*;CNC,CNC", RotateZ="true")
rule_19 = Rule(Name="MTLCorner", Type="parallel", RuleDefinition="MTL,*;BLU,MTL=MTL,*;MTL,MTL", RotateZ="true")
rule_20 = Rule(Name="REDCorner", Type="parallel", RuleDefinition="RED,*;BLU,RED=RED,*;RED,RED", RotateZ="true")

# ---- group: Model Frame Parameters
model_samples = Merge(Data1=merge_3, Data2=merge, Data3=merge_2)  # -> flatten(Result)
number_slider_6 = Slider(10, range=0..10)

# ----
merge_13 = Merge(Data1=ruleset_10, Data2=ruleset_11, Data3=ruleset_12)
ribbon_windows = RibbonWindows()
ground_plane = GroundPlane()
floors = Floors()
walls = Walls()
floor_planes = FloorPlanes()
columns = Columns()
ruleset_16 = RuleSet(Name="CornerMaterialRandomRS", Type="random", Repeat="true", Children=merge_13)
merge_14 = Merge(
    Data1=rule_13,
    Data2=ruleset_13,
    Data3=ruleset_14,
    Data4=ruleset_15,
    Data5=rule_15,
    Data6=rule_16,
    Data7=rule_14,
    Data8=rule_18,
    Data9=rule_19,
    Data10=rule_20,
    Data11=rule_17,
    Data12=ruleset_16)
ruleset_17 = RuleSet(Name="MaterialSwitchRS", Type="sequence", Children=merge_14)
merge_15 = Merge(Data1=ground_plane, Data2=floor_planes, Data3=floors, Data4=columns, Data5=walls, Data6=ribbon_windows, Data7=ruleset_17)
ruleset_18 = RuleSet(Name="ModernHouse", Children=merge_15)

# ---- group: RuleSet file paths
rulesets = Merge(
    Data1=panel_2,
    Data2=panel_6,
    Data3=panel,
    Data4=panel_3,
    Data5=panel_7,
    Data6=panel_8,
    Data7=panel_4,
    Data8=ruleset_18,
    Data9=panel_5)

# ---- group: Initiate Main
refresh_2 = Button()
init_mj = InitiateMJ(Spaces=mj_space, Rulesets=rulesets, EnableDebug=Toggle(True), Refresh=refresh_2)  # -> MJ_Main, DebugLog

# ----
run_mj = RunMJ(
    MJ_Main=init_mj.MJ_Main,
    Space=panel_9,
    Ruleset="ModernHouse",
    MaximumOperations=number_slider_4,
    RandomSeed=number_slider_5,
    Refresh=refresh)  # -> MJ_Main, DebugLog

# ---- group: Output MJ
subtraction = Subtraction(A=frame_1000, _1=1)
output_mj = OutputMJ(MJ_Main=run_mj.MJ_Main, Space=panel_9)  # -> MJ_Main, OperationCount, FrameCount, Frame, AllFrames, RuleRun
rule_run = Panel(output_mj.RuleRun)
op_count = Panel(output_mj.OperationCount)
frame_count = Panel(output_mj.FrameCount)
panel_11 = Panel(output_mj.Frame)

# ---- group: Model Frame
model_frame = ModelFrame(
    Frame=output_mj.Frame,
    XSize=number_slider,
    YSize=number_slider_2,
    ZSize=number_slider_3,
    Spacing=number_slider_6,
    Samples=model_samples)
object_20 = ModelObject(Object=model_frame)  # -> Object, Geometry, Name, Layer, Visibility, Display, Drafting, Render
action = Action({"Purge", "Pull", "Push", "Bake"}, selected="Push")
material = CreateMaterial(
    Diffuse=ColourSwatch(SwatchColor=RGB(158, 44, 44)),
    Specular=RGB(255, 255, 255),
    Emission=RGB(0, 0, 0),
    Transparency=0,
    Shine=0)
preview = CustomPreview(Geometry=object_20.Geometry, Material=material)  # disabled
cache = ContentCache(Content=object_20.Object, Action=action, UseTasks=False)
panel_12 = Panel(cache)
lng = ListLength(List=cache)
panel_13 = Panel(lng)

# ----
panel_14 = Panel(run_mj.DebugLog)
panel_15 = Panel(ruleset_18)
cache_2 = ContentCache(Content=cache, Action=Button())

# ==== cluster GroundPlane
rule = Rule(Name="GSpread", Type="parallel", RuleDefinition="AIR,BOX=BOX,BOX", RotateZ="true")
ruleset = RuleSet(Name="GroundSpread", Type="sequence", Repeat="true", Children=rule)
rule_2 = Rule(Name="GroundDrop", RuleDefinition="AIR/BOX=BOX/AIR")
rule_3 = Rule(Name="GroundSeed", Limit="1", RuleDefinition="AIR=BOX")
merge = Merge(Data1=rule_3, Data2=rule_2, Data3=ruleset)
ruleset_2 = RuleSet(Name="GroundPlane", Limit="1", Repeat="true", Children=merge)
rs = ClusterOutput(ruleset_2)

# ==== cluster FloorPlanes
break = Break(Name="break2", Weight="1")
rule = Rule(Name="FPTowerRiseRandomUp", Weight="2", RuleDefinition="BLU/AIR=BLU/BLU")
merge = Merge(Data1=rule, Data2=break)
ruleset = RuleSet(Name="FPTowerRiseRandomUpRS", Type="random", Repeat="true", Children=merge)
rule_2 = Rule(Name="FPTowerRiseFloorMarker", RuleDefinition="BLU/AIR=BLU/SPS")
rule_3 = Rule(Name="FPTowerRiseFloorRestart", RuleDefinition="SPS/AIR/AIR=SPS/BLU/BLU")
merge_2 = Merge(Data1=rule_3, Data2=ruleset, Data3=rule_2)
ruleset_2 = RuleSet(Name="FPTowerRiseSeqRS", Type="sequence", Weight="2", Children=merge_2)
break_2 = Break(Name="break1", Weight="1")
merge_3 = Merge(Data1=ruleset_2, Data2=break_2)
rule_4 = Rule(Name="FPTowerBase", Limit="1", RuleDefinition="BOX/AIR=BOX/BLU")
rule_5 = Rule(Name="FPTowerRiseMin", Limit="2", RuleDefinition="BLU/AIR=BLU/BLU")
rule_6 = Rule(Name="FPTowerCap", RuleDefinition="BLU/AIR=BLU/SPS")
ruleset_3 = RuleSet(Name="FPTowerRise", Type="random", Repeat="true", Children=merge_3)
rule_7 = Rule(Name="FPSpread", Type="parallel", RuleDefinition="SPS,*=SPS,SPS", RotateZ="true")
merge_4 = Merge(Data1=rule_4, Data2=rule_5, Data3=ruleset_3, Data4=rule_6)
rule_8 = Rule(Name="FPClearBLU", Type="parallel", Limit="1", RuleDefinition="BLU=AIR")
ruleset_4 = RuleSet(Name="FloorPlanes", Limit="1", Children=merge_4)
rule_9 = Rule(Name="FloorPlaneFindNonEdge", Type="parallel", RuleDefinition="SPS,SPS,SPS;SPS,SPS,SPS;SPS,SPS,SPS=*,*,*;*,BXS,*;*,*,*")
ruleset_5 = RuleSet(Name="FPSpreadRS", Type="sequence", Repeat="true", Children=rule_7)
merge_5 = Merge(Data1=ruleset_4, Data2=rule_8, Data3=ruleset_5, Data4=rule_9)
R = ClusterOutput(merge_5)

# ==== cluster Floors
break = Break(Name="BREAK4")
rule = Rule(Name="FloorSpreadRandom", Type="parallel", Weight="2", RuleDefinition="BXS,*;*,RED=RED,RED;RED,RED", RotateZ="true")
break_2 = Break(Name="BREAK3")
rule_2 = Rule(Name="FloorMinSpreadRandom", Type="parallel", Weight="2", RuleDefinition="BXS,*;*,RED=RED,RED;RED,RED", RotateZ="true")
merge = Merge(Data1=rule, Data2=break)
merge_2 = Merge(Data1=rule_2, Data2=break_2)
rule_3 = Rule(Name="FloorREDtoORG", Type="parallel", RuleDefinition="RED=ORG")
rule_4 = Rule(
    Name=["FloorSpreadMin1", "FloorSpreadMin2", "FloorSpreadMin3"],
    Type="parallel",
    RuleDefinition="BXS,*;*,RED=RED,RED;RED,RED",
    RotateZ="true")
rule_5 = Rule(Name="FloorSeed", RuleDefinition="BXS=RED")
ruleset = RuleSet(Name="FloorSpreadRandomRS", Type="random", Repeat="true", Children=merge)
rule_6 = Rule(Name="FloorMinREDtoORG", Type="parallel", RuleDefinition="RED=ORG")
rule_7 = Rule(
    Name=["FloorMinSpreadMin1", "FloorMinSpreadMin2", "FloorMinSpreadMin3"],
    Type="parallel",
    RuleDefinition="BXS,*;*,RED=RED,RED;RED,RED",
    RotateZ="true")
rule_8 = Rule(Name="FloorMinSeed", RuleDefinition="BXS=RED")
ruleset_2 = RuleSet(Name="FloorMinSpreadRandomRS", Type="random", Repeat="true", Children=merge_2)
merge_3 = Merge(Data1=rule_5, Data2=rule_4, Data3=ruleset, Data4=rule_3)
merge_4 = Merge(Data1=rule_8, Data2=rule_7, Data3=ruleset_2, Data4=rule_6)
panel = Panel("true")
ruleset_3 = RuleSet(Name="FloorRS", Type="sequence", Weight="5", Children=merge_3)
break_3 = Break(Name="BREAK5")
ruleset_4 = RuleSet(Name="FloorMinRS", Type="sequence", Children=merge_4)
merge_5 = Merge(Data1=ruleset_3, Data2=break_3)
ruleset_5 = RuleSet(Name="FloorRandomRS", Type="random", Repeat="true", Children=merge_5)
merge_6 = Merge(Data1=ruleset_4, Data2=ruleset_5)
ruleset_6 = RuleSet(Name="Floors", Type="sequence", Children=merge_6)
rs = ClusterOutput(ruleset_6)

# ==== cluster Columns
rule = Rule(Name="ColumnDrop", Type="parallel", RuleDefinition="*/BLU=BLU/BLU")
rule_2 = Rule(
    Name=["OutsideCorner", "InsideCorner1", "InsideCorner2a", "InsideCorner2b", "InsideCorner3"],
    Type="parallel",
    RuleDefinition=["ORG,BXS;BXS,BXS=BLU,*;*,*", "ORG,ORG;BXS,ORG=*,BLU;*,*", "ORG,ORG;BXS,BLU=*,BLU;*,*", "ORG,ORG;BLU,BXS=BLU,*;*,*", "BLU,ORG;BXS,BLU=*,BLU;*,*"],
    RotateZ="true")
ruleset = RuleSet(Name="ColumnDropRuleset", Type="sequence", Repeat="true", Children=rule)
rule_3 = Rule(
    Name=["ColumnSPStoBXS", "NonEdgeFloor"],
    Type="parallel",
    RuleDefinition=["SPS=BXS", "ORG,ORG,ORG;ORG,ORG,ORG;ORG,ORG,ORG=*,*,*;*,YLW,*;*,*,*"])
merge = Merge(Data1=rule_3, Data2=rule_2, Data3=ruleset)
ruleset_2 = RuleSet(Name="Columns", Type="sequence", Children=merge)
rule_4 = Rule(Name="ClearBXS", Type="parallel", RuleDefinition="BXS=AIR")
merge_2 = Merge(Data1=ruleset_2, Data2=rule_4)
R = ClusterOutput(merge_2)

# ==== cluster Walls
rule = Rule(Name="WallDrop", Type="parallel", RuleDefinition="AIR/PRP=PRP/PRP")
rule_2 = Rule(Name="WallsTopEdge", Type="parallel", RuleDefinition="AIR/ORG=PRP/ORG")
ruleset = RuleSet(Name="WallDropRS", Type="sequence", Repeat="true", Children=rule)
merge = Merge(Data1=rule_2, Data2=ruleset)
ruleset_2 = RuleSet(Name="Walls", Type="sequence", Children=merge)
rs = ClusterOutput(ruleset_2)

# ==== cluster RibbonWindows
rule = Rule(Name="VertSpanWindow", Type="parallel", RuleDefinition="GRN/PRP=GRN/GRN", ReflectZ="true")
rule_2 = Rule(Name="HorzSpanWindow", Type="parallel", RuleDefinition="GRN,PRP=GRN,GRN", RotateZ="true")
ruleset = RuleSet(Name="VertRibbonWindow", Type="sequence", Weight="2", Repeat="true", Children=rule)
ruleset_2 = RuleSet(Name="HorzRibbonWindow", Type="sequence", Weight="3", Repeat="true", Children=rule_2)
merge = Merge(Data1=ruleset, Data2=ruleset_2)
rule_3 = Rule(Name="PickWindow", RuleDefinition="SPS=GRN")
ruleset_3 = RuleSet(Name="PickVertOrHorzRibbon", Type="random", Children=merge)
rule_4 = Rule(Name="GRNtoRED", Type="parallel", RuleDefinition="GRN=RED")
merge_2 = Merge(Data1=rule_3, Data2=ruleset_3, Data3=rule_4)
break = Break(Name="BREAK6")
rule_5 = Rule(Name="WindowSeed", Weight="15", RuleDefinition="PRP=SPS")
ruleset_4 = RuleSet(Name="RibbonWindowSeqRS", Type="sequence", Repeat="true", Children=merge_2)
rule_6 = Rule(Name=["WindowsX", "WindowsY"], Type="parallel", RuleDefinition=["AIR;RED;AIR=AIR;WDX;AIR", "AIR,RED,AIR=AIR,WDY,AIR"])
merge_3 = Merge(Data1=rule_5, Data2=break)
merge_4 = Merge(Data1=ruleset_4, Data2=rule_6)
ruleset_5 = RuleSet(Name="WindowSeedRandomRS", Type="random", Repeat="true", Children=merge_3)
ruleset_6 = RuleSet(Name="RibbonWindowRS", Type="sequence", Children=merge_4)
merge_5 = Merge(Data1=ruleset_5, Data2=ruleset_6)
ruleset_7 = RuleSet(Name="Windows", Type="sequence", Children=merge_5)
rs = ClusterOutput(ruleset_7)
